# Dynamo graph ExportWallsFloorsToHyparJSON.dyn (Dynamo 2.3.0.5885)
# packages: Hypar Dynamo 0.0.5

file_path = Filename(".\ExportedWallsFloors.json")
categories = Categories("OST_Walls")
all_elements_of_category = ElementsOfCategory(Category=categories)
fromRevitWall = HyparDynamo.Hypar.Wall.FromRevitWall(revitWall=all_elements_of_category)
flatten = List.Flatten(list=fromRevitWall)
isNull = Object.IsNull(obj=flatten)
filterByBoolMask = List.FilterByBoolMask(list=flatten, mask=isNull)
categories_2 = Categories("OST_Floors")
all_elements_of_category_2 = ElementsOfCategory(Category=categories_2)
fromRevitFloor = HyparDynamo.Hypar.Floor.FromRevitFloor(revitFloor=all_elements_of_category_2)
flatten_2 = List.Flatten(list=fromRevitFloor)
isNull_2 = Object.IsNull(obj=flatten_2)
filterByBoolMask_2 = List.FilterByBoolMask(list=flatten_2, mask=isNull_2)
join = List.Join(list0=filterByBoolMask.out, list1=filterByBoolMask_2.out)
fromElements = HyparDynamo.Hypar.Model.FromElements(elements=join)
writeJson = HyparDynamo.Hypar.Model.WriteJson(filePath=file_path, model=fromElements)
